% Simulink data dictionary RectData.sldd

ADC_input = Simulink.Bus()
  Vinp: single, Unit="V"  % ADCA0
  Vinn: single, Unit="V"  % ADCA1
  Vout: single, Unit="V"  % ADCA2
  Iout: single, Unit="A"  % ADCA5
  Iout_ref: single, Unit="A"  % ADCA6
  IL0: single, Unit="A"  % ADCC0
  IL_Offset: single, Unit="A"  % ADCC1
  IL_Ref: single, Unit="A"  % ADCC3
  IQ_sample: single, Unit="A"  % ADCC4

Conf = Simulink.VariantConfigurationData(
  struct(
    Configurations=[struct(Name="Configuration", Description="", ControlVariables=[]), struct(Name="Configuration_1", Description="", ControlVariables=[])],
    VariantConfigurations=[struct(Name="Configuration", Description="", ControlVariables=[], SubModelConfigurations=[]), struct(Name="Configuration_1", Description="", ControlVariables=[], SubModelConfigurations=[])],
    Constraints=[],
    PreferredConfiguration="",
    DefaultConfigurationName="",
    DataDictionaryName="",
    DataDictionarySection="",
    AreSubModelConfigurationsMigrated=true,
    ComponentConfigurationData=[],
    Version="24.2"))

Omega = Simulink.Parameter(314.1593, DataType="single", Unit="Hz")  % Grid Frequency
Ts0Single = Simulink.Parameter(Simulink.data.Expression(ExpressionString="Ts0"), DataType="single")

ADCScaleVoltageDCp = Simulink.Parameter(0.13431, DataType="single", Unit="V")  % 3.3V->4095
  % Sensor
  % 3V->500V
  % 500V->3722.72

ADCScaleVoltageAC = Simulink.Parameter(0.27, DataType="single", Unit="V")  % =(VacSample-1.6494)*335.2
  % 0V->1.65V
  % 2048->0V
  % 3250->325V
  % a*2048+b=0
  % a*3250+b=325
  % 0.27*X-553

ADCOffsetVoltageDCn = Simulink.Parameter(-544.81, DataType="single", Unit="V")
ADCOffsetVoltageAC = Simulink.Parameter(-553, DataType="single")

Signals = Simulink.Bus()
  IL: single, Unit="A"
  Vp: single, Unit="V"
  Vn: single, Unit="V"
  Vac: single, Unit="V"
  Iout: single, Unit="A"

ADCScaleVoltageDCn = Simulink.Parameter(0.133511, DataType="single", Unit="V")  % ADCinput=(3.28-Vdcs)*166.66
  % 0V->3.28V
  % 500V->0.27V
  % input:
  % 4070-->0V
  % 335->-500V
  % 0.13386*input-544.81

Output = Simulink.Bus()
  PWM: uint16  % PWM1-AB
  Sgn: boolean  % GPIO4
  Sgn__: boolean  % GPIO5
  Sgn120: boolean  % GPIO22
  Sgn240: boolean  % GPIO11
  EN_: boolean  % GPIO12
  ENinv: boolean  % GPIO13
  GEN: single  % GPIO-4A
  SGN2: boolean  % GPIO7

ADCScaleCurrent = Simulink.Parameter(0.01611, DataType="single", Unit="A")  % 50mV / Amp
  % ADC 3.3V->4095
  % 50mV->62.045454545
  % 1A->62.045454545

CurrentKp = Simulink.Parameter(0.0117, DataType="single")
CurrentKi = Simulink.Parameter(45.9, DataType="single")
Ts0 = Simulink.Parameter(0.0001)